# Grasshopper definition Jarvis March Concept.gh (Grasshopper 1.0.8)
# plug-ins: RhinoCodePluginGH

point = Point(flatten(Tree({0;0;0;0;0}: [Point(9.259724618, -58.30504397, 0), Point(92.03907819, -70.30667624, 0), Point(116.1386943, -34.97378236, 0), Point(89.98230627, -15.37592787, 0), Point(24.44646307, 42.10183494, 0)], {0;0;0;1;0}: [Point(39.46422528, -16.07093124, 0), Point(89.12565531, -28.07256352, 0), Point(113.2252714, 7.26033037, 0), Point(139.5649061, 77.29326088, 0), Point(93.39393366, 44.43106019, 0)], {0;0;0;2;0}: [Point(129.3607829, -19.12075518, 0), Point(170.4115528, -31.12238746, 0), Point(194.5111689, 4.210506432, 0), Point(168.3547809, 46.15030612, 0), Point(151.813792, 23.62955537, 0)], {0;0;0;3;0}: [Point(207.277742, -63.67372541, 0), Point(248.3285119, -75.67535769, 0), Point(333.5052313, -40.3424638, 0), Point(262.4742161, 48.33355653, 0), Point(206.006587, -20.92341486, 0)], {0;0;0;4;0}: [Point(163.1918653, -129.5591184, 0), Point(204.2426352, -178.9136899, 0), Point(228.3422513, -106.2278568, 0), Point(202.1858633, -72.38929516, 0), Point(161.9207103, -86.80880783, 0)], {0;0;0;5;0}: [Point(57.51784748, -97.21929244, 0), Point(101.6250718, -109.2209247, 0), Point(125.7246879, -73.88803082, 0), Point(99.56829989, -40.04946921, 0), Point(59.30314695, -54.46898188, 0)])))
deconstruct = Deconstruct(Point=point)  # -> XComponent, YComponent, ZComponent
panel = Panel("""15
60
90
24
56
9""")
c_script = CSharpScript(pts=point)  # -> out, a; inputs pts: list of Point3d
# ---------- c_script: C# ----------
// Grasshopper Script Instance
#region Usings
using System;
using System.Linq;
using System.Collections;
using System.Collections.Generic;
using System.Drawing;

using Rhino;
using Rhino.Geometry;

using Grasshopper;
using Grasshopper.Kernel;
using Grasshopper.Kernel.Data;
using Grasshopper.Kernel.Types;
#endregion

public class Script_Instance : GH_ScriptInstance
{
    #region Notes
    /* 
      Members:
        RhinoDoc RhinoDocument
        GH_Document GrasshopperDocument
        IGH_Component Component
        int Iteration

      Methods (Virtual & overridable):
        Print(string text)
        Print(string format, params object[] args)
        Reflect(object obj)
        Reflect(object obj, string method_name)
    */
    #endregion

    private void RunScript(List<Point3d> pts, ref object a)
    {
                // Assuming 'pts' is a list of Point3d objects
        List<Point3d> points = pts;  // Input 'pts' is a list of points

        // Sort the points based on their X coordinate
        points.Sort((p1, p2) => p1.X.CompareTo(p2.X));

        // Output the sorted list of points
        a = points;

        
        
        //a=Array.Sort(b);
        
        
        
    }
}
# ---------- end c_script ----------
sort_list = SortList(Keys=deconstruct.XComponent, ValuesA=point)  # -> Keys, ValuesA
c_script_2 = CSharpScript(x=panel)  # -> out, a; inputs x: Double
# ---------- c_script_2: C# ----------
// Grasshopper Script Instance
#region Usings
using System;
using System.Linq;
using System.Collections;
using System.Collections.Generic;
using System.Drawing;

using Rhino;
using Rhino.Geometry;

using Grasshopper;
using Grasshopper.Kernel;
using Grasshopper.Kernel.Data;
using Grasshopper.Kernel.Types;
#endregion

public class Script_Instance : GH_ScriptInstance
{
    #region Notes
    /* 
      Members:
        RhinoDoc RhinoDocument
        GH_Document GrasshopperDocument
        IGH_Component Component
        int Iteration

      Methods (Virtual & overridable):
        Print(string text)
        Print(string format, params object[] args)
        Reflect(object obj)
        Reflect(object obj, string method_name)
    */
    #endregion

    private void RunScript(double x, ref object a)
    {
        // Input: 'x' is a List<double> in Grasshopper
        List<double> values = x;  // 'x' is expected to be a List<double>

        // Sort the list in ascending order
        values.Sort();

        // Output the sorted list
        a = values;
    }
}
# ---------- end c_script_2 ----------
list_item = ListItem(List=sort_list.ValuesA, Index=0, Wrap=True)
panel_2 = Panel(c_script.a)
subtraction = Subtraction(A=sort_list.ValuesA, B=list_item)
unit_x = UnitX(Factor=1)
vector_display = VectorDisplay(Anchor=list_item, Vector=subtraction)
angle = Angle(VectorA=subtraction, VectorB=unit_x)  # -> Angle, Reflex
sort_list_2 = SortList(Keys=angle.Angle, ValuesA=sort_list.ValuesA)  # -> Keys, reverse(ValuesA)
list_item_2 = ListItem(List=sort_list_2.ValuesA, Index=0, Wrap=True)
# 1. Get x-value
# 2. Find the smallest x-value
# 3. Isolate point with smallest x-value
# 4. Calculate all vectors (subtract isolated point with all points)
# 5. Vector angle in respect to x-axis
# 6. Sort angles to the largest angle, in sync with the points
# 7. Isolate point that creates the largest angle
# 8. Repeat 4-6 *5 instead of x-axis, measure from the largest angle vector created
subtraction_2 = Subtraction(A=list_item_2, B=list_item)
subtraction_3 = Subtraction(A=sort_list_2.ValuesA, B=list_item_2)
reverse = Reverse(Vector=subtraction_2)
vector_display_2 = VectorDisplay(Anchor=list_item, Vector=subtraction_2)
vector_display_3 = VectorDisplay(Anchor=list_item_2, Vector=subtraction_3)
angle_2 = Angle(VectorA=subtraction_3, VectorB=reverse)  # -> Angle, Reflex
sort_list_3 = SortList(Keys=angle_2.Angle, ValuesA=sort_list_2.ValuesA)  # -> Keys, reverse(ValuesA)
list_item_3 = ListItem(List=sort_list_3.ValuesA, Index=0, Wrap=True)
panel_3 = Panel(sort_list_3.Keys)
subtraction_4 = Subtraction(A=list_item_3, B=list_item_2)
vector_display_4 = VectorDisplay(Anchor=list_item_2, Vector=subtraction_4)
