# Grasshopper definition DMesh Test.gh (Grasshopper 1.0.8)
# plug-ins: RhinoCodePluginGH

mesh = Mesh(<mesh referenced from the Rhino model>)
c_script = CSharpScript(mesh=mesh)  # -> out, a; inputs mesh: Mesh
# ---------- c_script: C# ----------
// Grasshopper Script Instance
#region Usings
using System;
#r "C:\Users\clark.cheng\OneDrive - UAP Company\Desktop\_COMMONS\UAP-Plugins\02_GH\_lib\geometry4Sharp-main\geometry4Sharp-main\bin\Release\geometry4sharp.dll"
using System.Linq;
using System.Collections;
using System.Collections.Generic;
using System.Drawing;

using Rhino;
using Rhino.Geometry;

using Grasshopper;
using Grasshopper.Kernel;
using Grasshopper.Kernel.Data;
using Grasshopper.Kernel.Types;

using g4;
#endregion

public class Script_Instance : GH_ScriptInstance
{
    #region Notes
    /* 
      Members:
        RhinoDoc RhinoDocument
        GH_Document GrasshopperDocument
        IGH_Component Component
        int Iteration

      Methods (Virtual & overridable):
        Print(string text)
        Print(string format, params object[] args)
        Reflect(object obj)
        Reflect(object obj, string method_name)
    */
    #endregion

    private void RunScript(Mesh mesh, ref object a)
    {
        // Write your logic here
        DMesh3 dm= new DMesh3(true,true,true,true);

        for (int i =0;i<mesh.Vertices.Count;i++)
        {
            Point3f vert=mesh.Vertices[i];
            
            g4.Vector3d v3 = new g4.Vector3d(vert.X,vert.Y,vert.Z);
            dm.AppendVertex(v3);
        }

        a=dm;
    }
}
# ---------- end c_script ----------
panel = Panel(c_script.a)
