# Grasshopper definition MeshLib.gh (Grasshopper 1.0.8)
# plug-ins: RhinoCodePluginGH, Pufferfish, Weaverbird

mesh = Mesh(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)
mesh_2 = Mesh(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)
close_mesh = CloseMesh(Mesh=mesh_2, Quadrangulate=False)  # -> Closed, Amount, Openings, ResultBoolean
close_mesh_2 = CloseMesh(Mesh=mesh, Quadrangulate=False)  # -> Closed, Amount, Openings, ResultBoolean
weaverbird_s_loop_subdivision = WeaverbirdsLoopSubdivision(MeshCurves=close_mesh.Closed, Level=1, SmoothNakedEdges=1)
weaverbird_s_loop_subdivision_2 = WeaverbirdsLoopSubdivision(MeshCurves=close_mesh_2.Closed, Level=1, SmoothNakedEdges=1)
number_slider = Slider(0.1, range=0..0.1)
c_script = CSharpScript(rhinoMesh=weaverbird_s_loop_subdivision)  # -> out, meshlibMesh; inputs rhinoMesh: Mesh
# ---------- c_script: C# ----------
// Grasshopper Script Instance
#region Usings
using System;
#r "nuget: MeshLib"
using System.Linq;
using System.Collections;
using System.Collections.Generic;
using System.Drawing;

using Rhino;
using Rhino.Geometry;

using Grasshopper;
using Grasshopper.Kernel;
using Grasshopper.Kernel.Data;
using Grasshopper.Kernel.Types;
using MR.DotNet;
#endregion

public class Script_Instance : GH_ScriptInstance
{
    #region Notes
    /* 
      Members:
        RhinoDoc RhinoDocument
        GH_Document GrasshopperDocument
        IGH_Component Component
        int Iteration

      Methods (Virtual & overridable):
        Print(string text)
        Print(string format, params object[] args)
        Reflect(object obj)
        Reflect(object obj, string method_name)
    */
    #endregion

    private void RunScript(Mesh rhinoMesh, ref object meshlibMesh)
    {
        try
        {
            // Convert Rhino mesh vertices to MR.DotNet.Vector3d format
            List<Vector3d> vertices = new List<Vector3d>();
            foreach (var vertex in rhinoMesh.Vertices)
            {
                vertices.Add(new Vector3d(vertex.X, vertex.Y, vertex.Z));
            }

            // Convert Rhino mesh faces to MR.DotNet format
            List<int[]> faces = new List<int[]>();
            foreach (var face in rhinoMesh.Faces)
            {
                if (face.IsTriangle)
                {
                    faces.Add(new int[] { face.A, face.B, face.C });
                }
                else if (face.IsQuad)
                {
                    // Split quads into two triangles
                    faces.Add(new int[] { face.A, face.B, face.C });
                    faces.Add(new int[] { face.A, face.C, face.D });
                }
            }

            // Create MeshLib mesh
            var mesh = new MR.DotNet.Mesh(vertices, faces);

            // Output the MeshLib mesh
            meshlibMesh = mesh;
        }
        catch (Exception ex)
        {
            throw new Exception($"Failed to convert Rhino mesh to MeshLib mesh: {ex.Message}");
        }
    }
}
# ---------- end c_script ----------
