# Grasshopper definition 2D Grid Distortion.gh (Grasshopper 1.0.8)

number_slider = Slider(30, range=0..100)
surface = Surface(<surface referenced from the Rhino model>)
divide_surface = DivideSurface(Surface=surface, UCount=number_slider, VCount=number_slider)  # -> Points, Normals, Parameters
point = Point(graft([<point referenced from the Rhino model> x5]))
flatten_tree = FlattenTree(Tree=divide_surface.Points, Path="{0}")
distance = Distance(PointA=flatten_tree, PointB=point)
smaller_than = SmallerThan(FirstNumber=distance, SecondNumber=Slider(42.51, range=0..100))  # -> SmallerThan, OrEqualTo
sift_pattern = SiftPattern(List=flatten_tree, SiftPattern=smaller_than.SmallerThan)  # -> Output0, Output1
point_2 = Point(sift_pattern.Output1)
flatten_tree_2 = FlattenTree(Tree=point_2, Path="{0}")
replace_nulls = ReplaceNulls(Items=flatten_tree_2, Replacements="0")  # -> Items, Count
equality = Equality(FirstNumber=replace_nulls.Items, SecondNumber="0")  # -> Equality, Inequality
sift_pattern_2 = SiftPattern(List=flatten_tree_2, SiftPattern=equality.Inequality)  # -> Output0, Output1
cull_pattern = CullPattern(List=flatten_tree_2, CullPattern=equality.Inequality)
flatten_tree_3 = FlattenTree(Tree=point, Path="{0}")
create_set = CreateSet(List=sift_pattern_2.Output1)  # -> Set, Map
closest_point = ClosestPoint(Point=flatten_tree, Cloud=flatten_tree_3)  # -> ClosestPoint, CPIndex, Distance
member_index = MemberIndex(Set=sift_pattern_2.Output1, Member=create_set.Set)  # -> Index, Count
bounds = Bounds(Numbers=closest_point.Distance)
equality_2 = Equality(FirstNumber=member_index.Count, SecondNumber="1")  # -> graft(Equality), Inequality
remap_numbers = RemapNumbers(Value=closest_point.Distance, Source=bounds, Target=Domain(0, 1))  # -> Mapped, Clipped
graph_mapper = GraphMapper(
    simplify(remap_numbers.Mapped),
    x0=0,
    x1=1,
    y0=0,
    y1=1,
    container_name="Gaussian",
    factor=0.2,
    mean=0.08965091407,
    sdev=0.1220508479)
cull_pattern_2 = CullPattern(List=member_index.Index, CullPattern=invert(equality_2.Equality))  # -> flatten(List)
cull_pattern_3 = CullPattern(List=member_index.Index, CullPattern=invert(equality_2.Equality))
bounds_2 = Bounds(Numbers=graph_mapper)
list_length = ListLength(List=cull_pattern_3)
remap_numbers_2 = RemapNumbers(Value=graph_mapper, Source=bounds_2, Target=Slider(6.78, range=-10..10))  # -> Mapped, Clipped
larger_than = LargerThan(FirstNumber=list_length, SecondNumber="0")  # -> LargerThan, OrEqualTo
replace_items = ReplaceItems(List=sift_pattern_2.Output1, Indices=cull_pattern_2, Wrap=False)
unflatten_tree = UnflattenTree(Tree=replace_items, Guide=point_2)
vector_2pt = Vector2Pt(PointA=point, PointB=unflatten_tree, Unitize=False)  # -> Vector, Length
replace_nulls_2 = ReplaceNulls(Items=vector_2pt.Vector, Replacements="{0,0,0}")  # -> Items, Count
flip_matrix = FlipMatrix(Data=replace_nulls_2.Items)
mass_addition = MassAddition(Input=flip_matrix)  # -> Result, PartialResults
flip_matrix_2 = FlipMatrix(Data=mass_addition.Result)
amplitude = Amplitude(Vector=flip_matrix_2, Amplitude=remap_numbers_2.Mapped)
cull_pattern_4 = CullPattern(List=list_length, CullPattern=larger_than.LargerThan)
move = Move(Geometry=flatten_tree, Motion=amplitude)  # -> Geometry, Transform
panel = Panel(remap_numbers_2.Mapped)
unflatten_tree_2 = UnflattenTree(Tree=move.Geometry, Guide=divide_surface.Points)
panel_2 = Panel(cull_pattern_3)
flip_matrix_3 = FlipMatrix(Data=unflatten_tree_2)
interpolate = Interpolate(Vertices=unflatten_tree_2, Degree=3, Periodic=False, KnotStyle=1)  # -> Curve, Length, Domain
interpolate_2 = Interpolate(Vertices=flip_matrix_3, Degree=3, Periodic=False, KnotStyle=1)  # -> Curve, Length, Domain
panel_3 = Panel(cull_pattern_4)
