# Grasshopper definition Minkowsi Sum.gh (Grasshopper 1.0.8)

curve = Curve(<curve referenced from the Rhino model>)
c_script = CSharpScript()  # -> out, a
# ---------- c_script: C# ----------
// Grasshopper Script Instance
#region Usings
using System;
using System.Linq;
using System.Collections;
using System.Collections.Generic;
using System.Drawing;

using Rhino;
using Rhino.Geometry;

using Grasshopper;
using Grasshopper.Kernel;
using Grasshopper.Kernel.Data;
using Grasshopper.Kernel.Types;
#endregion

public class Script_Instance : GH_ScriptInstance
{
    #region Notes
    /* 
      Members:
        RhinoDoc RhinoDocument
        GH_Document GrasshopperDocument
        IGH_Component Component
        int Iteration

      Methods (Virtual & overridable):
        Print(string text)
        Print(string format, params object[] args)
        Reflect(object obj)
        Reflect(object obj, string method_name)
    */
    #endregion

    private void RunScript(object x, object y, ref object a)
    {
        // Write your logic here
        a = null;
    }
}
# ---------- end c_script ----------
c_script_2 = CSharpScript(crv=curve, div=Slider(40, range=0..100), offset=Slider(1, range=0..1))  # -> out, a, b; inputs crv: Curve, div: Int32, offset: Double
# ---------- c_script_2: C# ----------
// Grasshopper Script Instance
#region Usings
using System;
using System.Linq;
using System.Collections;
using System.Collections.Generic;
using System.Drawing;

#r "D:\Architectural Templates\Ptarmigan\02_GH\_lib\Clipper2-main\Clipper2-main\Clipper2Lib.dll"

using Clipper2Lib;
using Rhino;
using Rhino.Geometry;

using Grasshopper;
using Grasshopper.Kernel;
using Grasshopper.Kernel.Data;
using Grasshopper.Kernel.Types;
#endregion

public class Script_Instance : GH_ScriptInstance
{
    #region Notes
    /* 
      Members:
        RhinoDoc RhinoDocument
        GH_Document GrasshopperDocument
        IGH_Component Component
        int Iteration

      Methods (Virtual & overridable):
        Print(string text)
        Print(string format, params object[] args)
        Reflect(object obj)
        Reflect(object obj, string method_name)
    */
    #endregion

    private void RunScript(
		Curve crv,
		int div,
		double offset,
		ref object a,
		ref object b)
    {
        List<Point3d> sample = new List<Point3d>();
        Point3d[] divpts;

        crv.DivideByCount(div,true, out divpts);

        sample.AddRange(divpts);

        //create circle with polys

        int seg=64;
        List<Point3d> circle = new List<Point3d>();

        for (int i=0; i<seg; i++)
        {
            double angle=2*Math.PI*i/seg;

            circle.Add(new Point3d(offset*Math.Cos(angle),offset*Math.Sin(angle),0));
            
        }

        List<Point3d> pts = new List<Point3d>();

        
        b=circle;

        PolylineCurve poly = new PolylineCurve(circle);
        a=poly;
    }
}
# ---------- end c_script_2 ----------
